# Grasshopper definition chasing.ghx (Grasshopper 1.0.7)

# ----
# Python Scripts
panel = Panel("send_v2.py")
ghpython_script = GhPythonScript(file_name=panel)  # -> path
# ---------- ghpython_script: Python ----------
a = ghdoc.Path
b = ghdoc.Name

path = (a[::-1].replace('xhg.'+b[::-1].replace('*','',1),'',1))[::-1]

path = path.split('\\')

hierarchy_number = len(file_name.split('\\'))
out_path =''
for n in range(len(path)-hierarchy_number):
    out_path += path[n] +'\\'
out_path += file_name
path = out_path
#+file_name
# ---------- end ghpython_script ----------
read_file = ReadFile(File=ghpython_script, PerLineParse=False)

ghpython_script_2 = GhPythonScript(file_name="listen_v2.py")  # -> path; same code as ghpython_script
read_file_2 = ReadFile(File=ghpython_script_2, PerLineParse=False)

ghpython_script_3 = GhPythonScript(file_name="orientation_v2.py")  # -> path; same code as ghpython_script
read_file_3 = ReadFile(File=ghpython_script_3, PerLineParse=False)

ghpython_script_4 = GhPythonScript(file_name="judgement_v2.py")  # -> path; same code as ghpython_script
read_file_4 = ReadFile(File=ghpython_script_4, PerLineParse=False)

ghpython_script_5 = GhPythonScript(file_name="cvLocations.json")  # -> path; same code as ghpython_script

# ----
# INPUT
safe_robot_acc = Slider(0.8, range=0..1)
safe_robot_vel = Slider(0.8, range=0..1)

safe_sleep_time = Slider(0.1, range=0..1)
# Robotic Navigation Data
id = Panel("192.168.10.10")
io = Panel("0")
tcp = Panel("""0
0
80
0.0
3.1415
1.57""")
table_navigation_points = Panel("""{-200 ,-320 ,-587.3}
{-201.8 ,-519.9 ,-587.3}
{200 ,-323.9 ,-587.3}""")
# DESING
ghpython_script_6 = GhPythonScript(x=ghpython_script_5)  # -> a
# ---------- ghpython_script_6: Python ----------
from compas import data

a = data.json_load(x)
# ---------- end ghpython_script_6 ----------

# ---- group: Debug Mode
debug = Slider(570, range=0..650)
pt = ConstructPoint(XCoordinate=debug, YCoordinate="0", ZCoordinate="0")

# ----
unit_x = UnitX(Factor=1)  # -> expr("-x", UnitVector)
unit_y = UnitY(Factor=1)  # -> expr("-x", UnitVector)
# EXCUTE
trigger = Trigger(Interval=2000, TimerInterval=2000, Target=[ghpython_script_6, python])  # disabled
construct_plane = ConstructPlane(Origin=pt, XAxis=unit_x, YAxis=unit_y)
cvarray = Panel(ghpython_script_6)
X = Slider(100, range=0..1000)
Y = Slider(160, range=0..1000)
number = Number([1.581140995, -0.4415987174, 1.977344513, 3.164097309, -1.595044915, 4.793690096e-05])
is_debug_mode = BooleanToggle(True)

# ---- group: SEND
fabricate = Button()
python = GhPythonScript(
    Code=read_file,
    ROBOT_IP=id,
    SAFE_ROBOT_ACC=safe_robot_acc,
    SAFE_ROBOT_VEL=safe_robot_vel,
    SAFE_SLEEP_TIME=safe_sleep_time,
    TCP=tcp,
    TABLE_NAVIGATION_POINTS=table_navigation_points,
    Stop_configurations=number,
    Fabricate=fabricate,
    CVarray=ghpython_script_6,
    Is_debug_mode=is_debug_mode,
    Debug_plane=construct_plane,
    X=X,
    Y=Y)  # -> Out, Script

# ----
panel_3 = Panel(python.Out)
panel_4 = Panel(python.Script)
