# Grasshopper definition continuous.ghx (Grasshopper 1.0.7)

# ----
# Python Scripts
panel = Panel("send_v2.py")
ghpython_script = GhPythonScript(file_name=panel)  # -> path
# ---------- ghpython_script: Python ----------
a = ghdoc.Path
b = ghdoc.Name

path = (a[::-1].replace('xhg.'+b[::-1].replace('*','',1),'',1))[::-1]

path = path.split('\\')

hierarchy_number = len(file_name.split('\\'))
out_path =''
for n in range(len(path)-hierarchy_number):
    out_path += path[n] +'\\'
out_path += file_name
path = out_path
#+file_name
# ---------- end ghpython_script ----------
read_file = ReadFile(File=ghpython_script, PerLineParse=False)

ghpython_script_2 = GhPythonScript(file_name="listen_v2.py")  # -> path; same code as ghpython_script
read_file_2 = ReadFile(File=ghpython_script_2, PerLineParse=False)

ghpython_script_3 = GhPythonScript(file_name="orientation_v2.py")  # -> path; same code as ghpython_script
read_file_3 = ReadFile(File=ghpython_script_3, PerLineParse=False)

ghpython_script_4 = GhPythonScript(file_name="judgement_v2.py")  # -> path; same code as ghpython_script
read_file_4 = ReadFile(File=ghpython_script_4, PerLineParse=False)

# ----
# INPUT
safe_robot_acc = Slider(1, range=0..1)
safe_robot_vel = Slider(1, range=0..1)

safe_sleep_time = Slider(0.1, range=0..1)
safe_dist = Slider(100, range=50..200)
# Robotic Navigation Data
id = Panel("192.168.10.10")
io = Panel("0")
tcp = Panel("""-0.35
0.5
89.08
0.0
3.1415
1.57""")
table_navigation_points = Panel("""{-200 ,-320 ,-587.3}
{-201.8 ,-519.9 ,-587.3}
{200 ,-323.9 ,-587.3}""")

# ---- group: Debug Mode
debug = Slider(500, range=0..500)
# EXCUTE
pt = ConstructPoint(XCoordinate="0", YCoordinate="0", ZCoordinate="0")
is_debug_mode = BooleanToggle(False)
construct_plane = ConstructPlane(Origin=pt, XAxis=Vector(1, 0, 0), YAxis=Vector(0, 1, 0))

# ----
# JUDGEMENT
trigger = Trigger(Interval=1000, TimerInterval=1000, Target=ghpython_script_5)  # disabled
# OPERATION
# LISTEN
listen = BooleanToggle(True)

reset = Button()
run = Button()

button = Button()
number = Number([1.581140995, -0.4415987174, 1.977344513, 3.164097309, -1.595044915, 4.793690096e-05])

# ---- group: Get robot pose
ghpython_script_5 = GhPythonScript(Code=read_file_2, TABLE_NAVIGATION_POINTS=table_navigation_points, Listen=listen)  # -> Out, Config

# ----
radians = Radians(Degrees=ghpython_script_5.Config)

ghpython_script_6 = GhPythonScript(Code=read_file_4, Current_configuration=radians, Stop_configuration=number, Reset=reset, Run=run, X=button)  # -> Out, Count, Fabricate

# ---- group: SEND
fabricate = Button()
python = GhPythonScript(
    Code=read_file,
    ROBOT_IP=id,
    SAFE_ROBOT_ACC=safe_robot_acc,
    SAFE_ROBOT_VEL=safe_robot_vel,
    SAFE_SLEEP_TIME=safe_sleep_time,
    TCP=tcp,
    TABLE_NAVIGATION_POINTS=table_navigation_points,
    Stop_configurations=number,
    Fabricate=ghpython_script_6.Fabricate,
    Is_debug_mode=is_debug_mode,
    Debug_plane=construct_plane)  # -> Out, Script

# ----
panel_2 = Panel(ghpython_script_6.Count)
panel_3 = Panel(ghpython_script_6.Fabricate)
panel_4 = Panel(radians)
panel_5 = Panel(python.Out)
panel_6 = Panel(python.Script)

# ---- group: Robot Base
# VISUALIZATION
geometry = Geometry(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)

# ---- group: Table
geometry_2 = Geometry(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)

# ----
ghpython_script_7 = GhPythonScript(config=radians)  # -> configuration; inputs config: list
# ---------- ghpython_script_7: Python ----------
from compas_fab.robots import Configuration

configuration = Configuration.from_revolute_values(config)
# ---------- end ghpython_script_7 ----------
ur10e = GhPythonScript()  # -> robot
# ---------- ur10e: Python ----------
import os

import compas_fab
from compas.artists import Artist
from compas.geometry import Frame
from compas.robots import RobotModel
from compas.robots.resources import LocalPackageMeshLoader
from compas_fab.backends import AnalyticalInverseKinematics
from compas_fab.backends import OffsetWristKinematics
from compas_fab.backends.interfaces import ClientInterface
from compas_fab.robots import Robot
from compas_fab.robots import RobotSemantics


canvas = ghenv.Component.OnPingDocument()

urdf_folder = os.path.join(os.path.dirname(canvas.FilePath), '..\\dependencies\\robots')
urdf_file = os.path.join(urdf_folder, 'ur10.urdf')
srdf_file = os.path.join(urdf_folder, 'ur10.srdf')

model = RobotModel.from_urdf_file(urdf_file)
model.load_geometry(LocalPackageMeshLoader(urdf_folder, 'ur_description'))

semantics = RobotSemantics.from_srdf_file(srdf_file, model)

client = ClientInterface()
client.is_connected = True
client.inverse_kinematics = AnalyticalInverseKinematics(solver='ur10')

robot = Robot(model, client=client, semantics=semantics)
robot.artist = Artist(model)
# ---------- end ur10e ----------
robot_visualize = COMPASFABRobotVisualize(robot=ur10e, configuration=ghpython_script_7, show_collision=True, show_frames=True, show_cm=False, show_acm=False)  # -> visual, collision, collision_meshes, attached_meshes, frames, base_frame, ee_frame; inputs show_visual: Boolean, show_collision: Boolean, show_frames: Boolean, show_base_frame: Boolean, show_end_effector_frame: Boolean, show_cm: Boolean, show_acm: Boolean
#   port group: The planning group used for end-effector and base visualization.
#   port configuration: The robot's full configuration.
#   port show_visual: Whether or not to show the robot's visual meshes.
#   port show_collision: Whether or not to show the robot's collision meshes.
#   port show_frames: Whether or not to show the robot's joint frames.
#   port show_base_frame: Whether or not to show the robot's base frame.
#   port show_end_effector_frame: Whether or not to show the robot's end-effector frame.
#   port show_cm: Whether or not to show the collision meshes (if any).
#   port show_acm: Whether or not to show the attached collision meshes (if any).
#   port visual: Rhino meshes of the robot's visual geometry (if any).
#   port collision: Rhino meshes of the robot's collision geometry (if any).
#   port collision_meshes: Rhino meshes of the scene's collision meshes (if any).
#   port attached_meshes: Rhino meshes of the scene's attached collision meshes (if any).
#   port frames: The robot's joint frames as Rhino planes (if any).
#   port base_frame: The robot's base frame as a Rhino plane (if any).
#   port ee_frame: The robot's end-effector frame as a Rhino plane (if any).
# ---------- robot_visualize: Python ----------
"""
Visualizes the robot.

COMPAS FAB v0.27.0
"""
from compas.artists import Artist
from compas.geometry import Frame
from compas.geometry import Transformation
from compas_fab.robots import PlanningScene
from ghpythonlib.componentbase import executingcomponent as component
import Rhino.Geometry as rg


class RobotVisualize(component):
    def RunScript(
        self,
        robot,
        group,
        configuration,
        show_visual,
        show_collision,
        show_frames,
        show_base_frame,
        show_end_effector_frame,
        show_cm,
        show_acm,
    ):

        visual = None
        collision = None
        collision_meshes = None
        attached_meshes = None
        frames = None
        base_frame = None
        ee_frame = None

        if robot:
            show_visual = True if show_visual is None else show_visual
            show_cm = True if show_cm is None else show_cm
            show_acm = True if show_acm is None else show_acm
            configuration = configuration or robot.zero_configuration()

            robot.update(configuration, visual=show_visual, collision=show_collision)
            compas_frames = robot.transformed_frames(configuration, group)

            if show_visual:
                visual = robot.artist.draw_visual()

            if show_collision:
                collision = robot.artist.draw_collision()

            if show_base_frame:
                base_compas_frame = compas_frames[0]
                artist = Artist(base_compas_frame)
                base_frame = artist.draw()

            if show_end_effector_frame:
                ee_compas_frame = robot.forward_kinematics(
                    configuration, group, options=dict(solver="model")
                )
                artist = Artist(ee_compas_frame)
                ee_frame = artist.draw()

            if show_frames:
                frames = []
                for compas_frame in compas_frames[1:]:
                    artist = Artist(compas_frame)
                    frame = artist.draw()
                    frames.append(frame)

            if show_cm or show_acm:
                scene = PlanningScene(robot)
                scene = robot.client.get_planning_scene()

                collision_meshes = []
                attached_meshes = []

                if show_cm:
                    for co in scene.world.collision_objects:
                        header = co.header
                        frame_id = header.frame_id
                        cms = co.to_collision_meshes()

                        for cm in cms:
                            if cm.frame != Frame.worldXY():
                                t = Transformation.from_frame(cm.frame)
                                mesh = cm.mesh.transformed(t)
                            else:
                                mesh = cm.mesh

                            collision_meshes.append(Artist(mesh).draw())

                if show_acm:
                    for aco in scene.robot_state.attached_collision_objects:
                        for acm in aco.to_attached_collision_meshes():
                            frame_id = aco.object["header"]["frame_id"]
                            frame = robot.forward_kinematics(
                                configuration, options=dict(link=frame_id)
                            )
                            t = Transformation.from_frame(frame)

                            # Local CM frame
                            if (
                                acm.collision_mesh.frame
                                and acm.collision_mesh.frame != Frame.worldXY()
                            ):
                                t = t * Transformation.from_frame(
                                    acm.collision_mesh.frame
                                )

                            mesh = acm.collision_mesh.mesh.transformed(t)

                            attached_meshes.append(Artist(mesh).draw())
#        for v in visual:
#            v.Transform(rg.Transform.Scale(rg.Point3d(0,0,0),10))
        return (
            visual,
            collision,
            collision_meshes,
            attached_meshes,
            frames,
            base_frame,
            ee_frame,
        )
# ---------- end robot_visualize ----------
mesh = Mesh(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)
plane = Plane(Plane(origin=(206.4206746, 305.6036945, -592.6716677), x=(0.003246674623, 0.9998239247, -0.01848184906), y=(-0.999938157, 0.00304934678, -0.01069503235)))
orientation_py = GhPythonScript(
    Code=read_file_3,
    Visual=robot_visualize.visual,
    Frames=robot_visualize.frames,
    TCP=tcp,
    End_effector=mesh,
    Transformation_plane=plane)  # -> Out, Robot_meshs, Endeffector_plane
mesh_colours = MeshColours(Mesh=orientation_py.Robot_meshs, Colours=ColourSwatch(SwatchColor=RGBA(212, 212, 212, 227)))
plane_2 = Plane(orientation_py.Endeffector_plane)
